vi "LFSR Generation.gvi"   [LabVIEW Communications System Design Software 2.0.1]
inputs:
  "# of bits to genreate": i32 = 140
  "PN sequence orger": enum{"galois-6", "galois-8", "galois-10"} = "galois-6"
  "Error In": error
outputs:
  "bits out": i8[]
  "spectrum of bits out": T1
  "Error Out": error
types:
  T1 = cluster{"x values": f64[], "histogram h(x)": f64[]}
uses:
  NI::Analysis::Statistics::Histogram (single-shot)(DBL Array).gvi
diagram:
  # #todo:
  case ($"Error In") {
    frame Error {
      w1 = default
      w2 = default
      w3 = $"Error In"
    }
    frame No Error {
      for (N = $"# of bits to genreate") {
        case ($"PN sequence orger") {
          frame "galois-6", Default {
            Is First Call() -> w5
            Feedback Node(input=w6) -> w7
            Feedback Node(input=w7) -> w8
            Feedback Node(input=w9) -> w10
            Feedback Node(input=w10) -> w4
            Logical Exclusive Or(w4, w10, w8, w7) -> w11
            Select(s=w5, t=TRUE, f=w11) -> w12
            Feedback Node(input=w12) -> w6
            # 02356
            Feedback Node(input=w8) -> w9
          }
          frame "galois-8" {
            Is First Call() -> w13
            Feedback Node(input=w14) -> w15
            # 04568
            Feedback Node(input=w15) -> w16
            Feedback Node(input=w16) -> w17
            Feedback Node(input=w18) -> w4
            Logical Exclusive Or(w4, w17, w16, w15) -> w19
            Select(s=w13, t=TRUE, f=w19) -> w20
            Feedback Node(input=w20) -> w21
            Feedback Node(input=w21) -> w22
            Feedback Node(input=w22) -> w14
            Feedback Node(input=w17) -> w18
          }
          frame "galois-10" {
            Is First Call() -> w23
            Feedback Node(input=w24) -> w25
            Feedback Node(input=w26) -> w4
            Logical Exclusive Or(w4, w25) -> w27
            Select(s=w23, t=TRUE, f=w27) -> w28
            Feedback Node(input=w28) -> w29
            Feedback Node(input=w29) -> w30
            Feedback Node(input=w30) -> w31
            Feedback Node(input=w31) -> w32
            # 0 7 10
            Feedback Node(input=w32) -> w33
            Feedback Node(input=w33) -> w24
            Feedback Node(input=w25) -> w34
            Feedback Node(input=w34) -> w26
          }
        }
        Boolean To Integer(Boolean=w4) -> (0, 1=w35)
        To Byte Integer(number=w35) -> w36
        append w36 to w2
      }
      call "Histogram (single-shot)(DBL Array).gvi"(signal=w2, error in=$"Error In") -> (histogram=w1, error out=w3)
    }
  }
  $"bits out" <- w2
  $"spectrum of bits out" <- w1
  $"Error Out" <- w3
