vi "Demodulation (PSK).gvi"   [LabVIEW Communications System Design Software 2.0.1]
inputs:
  "Waveform in": cluster{"t0": f64, "dt": f64, "Y": c128[]} = {"t0"=0, "dt"=1, "Y"=[]}
  "error in": error
  "Demodulation parameters": "Demodulation parameters.gtype"
outputs:
  "Messages out": i8[][]
  "error out": error
  "Sync found": bool
  "output complex waveform": cluster{"t0": f64, "dt": f64, "Y": c128[]}
types:
  T1 = cluster{"samples per symbol (16)": i32, "symbol map": c128[], "differential PSK": enum{"disable", "enable"}, "PSK type": enum{"normal", "shifted", "offset"}}
  "Burst Parameters.gtype" = cluster{"# Message Symbols": i32, "# Guard Symbols": i32, "Sync Bits": u16}
  "Coding and CRC.gtype" = cluster{"Rate (k/n)": enum{"1/2", "none"}, "CRC seed": u16}
  "Demodulation parameters.gtype" = cluster{"PSK system parameters": T1, "pulse shaping filter coefficients": f64[], "matched filter coefficients": f64[], "Burst Parameters": "Burst Parameters.gtype", "Coding and CRC": "Coding and CRC.gtype"}
diagram:
  # 1. Matched Filtering
  # 2. Finding the middle of a symbol  (as it was oversampled) using gardner algorithm.
  # 3. Decimate oversampled data using error array of gardner.
  # 4. turn BPSK symbols to 0 and 1. (decision making)
  # 5. Find sync sequence. If found cut down the message bits from burst (guard and sinc bits)
  # 6. Calculating the lenght of the message symbols. (add CRC; + additional bits from coding; multibly because of the code rate.)
  case ($"error in") {
    frame Error {
      w1 = $"error in"
      w2 = default
      w3 = $"Waveform in"
      w4 = default
    }
    frame No Error {
      Property Node(instance in=$"Demodulation parameters") -> ("Burst Parameters:Sync Bits"=w5, "Burst Parameters:# Message Symbols"=w6, "Coding and CRC:Rate (k/n)"=w7)
      # 1
      call "Matched Filtering.gvi"(Modulated waveform in=$"Waveform in", Error in=$"error in", Demodulation parameters=$"Demodulation parameters") -> (Filtered waveform out=w3, Filtered bits out=w8, Error out=w9)
      call "Timing Recovery.gvi"(Bits in=w8, Demodulation parameters=$"Demodulation parameters", Error In=w9) -> (Error Out=w10, Bits out=w11, Timing shift=w12)
      # 3
      call "Decimating.gvi"(Timing shift=w12, Bits in=w11, Demodulation parameters=$"Demodulation parameters", Error In=w10) -> (Decimated bits out=w13, Error Out=w14)
      # 4
      call "Decision.gvi"(Bits in=w13, Error In=w14) -> (Demodulated bits=w15, Error Out=w16)
      # w6: #Message symbols
      # w7: Coding Rate
      # 6
      case (w7) {
        frame "1/2", Default {
          w17 = 2
          w18 = 7
        }
        frame "none" {
          Divide(x=3, y=2) -> w17
          w18 = 4
        }
      }
      # 2
      Add(w6, 16) -> w19
      # w5: Sync bits
      Add(w19, w18) -> w20
      To Double Precision Float(number=w20) -> w21
      Multiply(w21, w17) -> w22
      To Long Integer(number=w22) -> w23
      # 5
      call "Sync search.gvi"(Bits in=w15, Sync bits=w5, Burst Parameters:# Message Symbols=w23, Error In=w16) -> (Sync found=w2, Messages out=w4, Error Out=w1)
    }
  }
  $"output complex waveform" <- w3
  $"Messages out" <- w4
  $"Sync found" <- w2
  $"error out" <- w1
