vi "Modulation test.gvi"   [LabVIEW Communications System Design Software 2.0.1]
panel controls:
  "symbol rate": f64 = 10000
  "PSK Parameters": T2 = {"samples per symbol"=16, "M-PSK"=2, "differential PSK"="enable", "PSK type"="normal"}
  "Tab": i32
  "Burst Parameters": "Burst Parameters.gtype" = {"# Message Symbols"=1000, "# Guard Symbols"=80, "Sync Bits"=61440}
  "Cluster Constant": "Filter.gtype" = {"Transmit filter"="Raised Cosine", "Pulse filter parameter"=0.5, "Receive filter"="Root Raised Cos", "Matched filter parameter"=0.5}
  "Coding and CRC": "Coding and CRC.gtype" = {"Rate (k/n)"="1/2", "CRC seed"=4080}
  "eb/n0 [dB of complex]": f64 = 10
panel indicators:
  "Constellation": T1[]
  "Modulation": waveform<f64>
  "Demodulation": f64[][]
  "Sync found": bool
  "CRC": u16
types:
  T1 = cluster{"constellation": f64[], "oversampled data": f64[]}
  T2 = cluster{"samples per symbol": i32, "M-PSK": i32, "differential PSK": enum{"disable", "enable"}, "PSK type": enum{"normal", "shifted", "offset"}}
  "Burst Parameters.gtype" = cluster{"# Message Symbols": i32, "# Guard Symbols": i32, "Sync Bits": u16}
  T3 = enum{"none", "Raised Cosine", "Root Raised Cos", "Gaussian"}
  "Filter.gtype" = cluster{"Transmit filter": T3, "Pulse filter parameter": f64, "Receive filter": T3, "Matched filter parameter": f64}
  "Coding and CRC.gtype" = cluster{"Rate (k/n)": enum{"1/2", "none"}, "CRC seed": u16}
diagram:
  Property Node(instance in=$"PSK Parameters")
  Property Node(instance in=$"Coding and CRC") -> ("Rate (k/n)"=w1)
  call "Modulation init.gvi"(PSK Parameters=$"PSK Parameters", Filter=$"Cluster Constant", Burst Parameters=$"Burst Parameters", Coding and CRC=$"Coding and CRC") -> (Demodulation parameters=w2, Modulation parameters=w3, error out=w4)
  # ----------------------------------TRANSMITTER-----------------------------------------
  Property Node(instance in=$"Burst Parameters") -> ("# Message Symbols"=w5, "# Guard Symbols"=w6, "Sync Bits"=w7)
  call "Message bit generation.gvi"(# Message Symbols=w5, error in=w4) -> (Output Bit Stream=w8, error out=w9)
  Array Size(array=w8) -> (size(s)=w10)
  # --------INITIALIZATION------
  call "CRC.gvi"(Message In=w8, Error In=w9, Forward?=TRUE, # of MSG bits=w10) -> (Data out=w11, Error Out=w12)
  call "Convolutional Coder.gvi"(Input bitstream=w11, Rate (k/n)=w1, Error in=w12) -> (Coded bit stream=w13, Error out=w14)
  call "Burst Building.gvi"(Sync Bits=w7, Input bit stream=w13, error in=w14, # Guard Symbols=w6) -> (Output bit stream=w15, error out=w16)
  call "Modulation (PSK).gvi"(input bit stream=w15, Modulation parameters=w3, symbol rate=$"symbol rate", error in=w16) -> (error out=w17, output complex waveform=w18)
  call "AWGN generation.gvi"(Waveform in=w18, symbol rate=$"symbol rate", eb/n0 [dB of complex]=$"eb/n0 [dB of complex]", Error In=w17) -> (Error Out=w19, Waveform out=w20)
  call "Demodulation (PSK).gvi"(Waveform in=w20, error in=w19, Demodulation parameters=w2) -> (Messages out=w21, error out=w22, Sync found=w23, output complex waveform=w24)
  # -------------------------------------RECIEVER------------------------------------
  s1 = w22  # shift register
  for {
    w25 = each element of w21
    call "MT Format Constellation.gvi"(waveform=w24) -> (constellation graph=w26)
    $Constellation <- w26
    Property Node(instance in=w24) -> ("Y"=w27, "dt"=w28)
    Complex To Real Imaginary(x + iy=w27) -> (x=w29)
    Build Waveform Node(Y=w29, dt=w28) -> (output waveform=w30)
    $Modulation <- w30
    $"Sync found" <- w23
    To Double Precision Float(number=w8) -> w31
    call "Convolutional Decoder.gvi"(Coding rate=w1, Coded bit stream=w25, Error in=s1) -> (Decoded bits=w32, Error Out=w33)
    call "CRC.gvi"(Message In=w32, Error In=w33, Forward?=FALSE, # of MSG bits=w10) -> (Data out=w34, CRC value=w35, Error Out=w36)
    To Double Precision Float(number=w34) -> w37
    Build Array(w31, w37) -> w38
    $Demodulation <- w38
    Add Array Elements(numeric array=w35) -> (sum=w39)
    $CRC <- w39
    next s1 = w36
  }
  call "Display Error.gvi"(error in=s1)
