vi "Pulse Shaping Filter.gvi"   [LabVIEW Communications System Design Software 2.0.1]
inputs:
  "Bits in": c128[]
  "Filter Coefficients": f64[]
  "Symbol Rate [Hz]": f64
  "Error in": error
  "Samples per Symbol": i32
outputs:
  "Modulated bits out": c128[]
  "Modulated waveform out": cluster{"t0": f64, "dt": f64, "Y": c128[]}
  "Error out": error
types:
  "filter structure.gtype" = u32
  "filter.gtype" = cluster{"filter structure": "filter structure.gtype", "forward coefficients": f64[], "reverse coefficients": f64[], "sampling frequency": f64}
uses:
  NI::Analysis::Filtering::Filtering (CDB).gvi
diagram:
  case ($"Error in") {
    frame Error {
      w1 = $"Bits in"
      w2 = default
      w3 = $"Error in"
    }
    frame No Error {
      w4 = cluster{"t0": f64, "dt": f64, "Y": c128[]} {all zero or empty}
      Array Size(array=$"Filter Coefficients") -> (size(s)=w5)
      w6 = "filter.gtype" {"filter structure"=3, "forward coefficients"=[], "reverse coefficients"=[], "sampling frequency"=0}
      Property Node(instance in=w6, "forward coefficients"=$"Filter Coefficients") -> (instance out=w7)
      Initialize Array(element=1+0i, size=w5) -> w8
      Build Array[ConcatenateInputs=True](w8, $"Bits in") -> w9
      call "Filtering (CDB).gvi"(signal=w9, filter=w7, error in=$"Error in") -> (filtered signal=w10, error out=w3)
      Delete From Array(inArray=w10, length (1)=w5) -> w1
      Multiply($"Samples per Symbol", $"Symbol Rate [Hz]") -> w11
      Reciprocal(x=w11) -> w12
      Property Node(instance in=w4, "dt"=w12, "Y"=w1) -> (instance out=w2)
    }
  }
  $"Modulated bits out" <- w1
  $"Modulated waveform out" <- w2
  $"Error out" <- w3
